# Grasshopper definition curved-ice-wall.ghx (Grasshopper 1.0.9)
# plug-ins: Miki IceWorld

# ---- group: 01 INPUTS — metres / test assumptions
radius = Slider(5, range=0.5..30)
angle = Slider(120, range=10..300)
height = Slider(2.4, range=0.3..8)
thickness = Slider(0.5, range=0.1..2)
segments = Slider(12, range=2..256)
courses = Slider(4, range=1..32)
joint = Slider(0.01, range=0.001..0.03)

# ---- group: 02 GENERATION — preview geometry
curved_ice_wall = CurvedIceWall(Radius=radius, Angle=angle, Height=height, Thickness=thickness, Segments=segments, Courses=courses, Joint=joint)  # -> Geometry, Roles, Source, Report

# ---- group: 03 OUTPUT / APPROVAL — button to bake
bake = ApprovedBake(Source=curved_ice_wall.Source, Bake=Button())
panel = Panel(curved_ice_wall.Report)
