# Grasshopper definition platform-railing.ghx (Grasshopper 1.0.9)
# plug-ins: Miki IceWorld

# ---- group: 01 INPUTS — metres / test assumptions
length = Slider(6, range=1..30)
width = Slider(4, range=1..30)
elevation = Slider(1.8, range=0.3..8)
railheight = Slider(1.1, range=0.5..2)
railradius = Slider(0.025, range=0.01..0.1)
postspacing = Slider(1, range=0.25..3)

# ---- group: 02 GENERATION — preview geometry
platform_railing = PlatformRailing(Length=length, Width=width, Elevation=elevation, RailHeight=railheight, RailRadius=railradius, PostSpacing=postspacing)  # -> Geometry, Roles, Source, Report

# ---- group: 03 OUTPUT / APPROVAL — button to bake
bake = ApprovedBake(Source=platform_railing.Source, Bake=Button())
panel = Panel(platform_railing.Report)
