# Grasshopper definition queue-barriers.ghx (Grasshopper 1.0.9)
# plug-ins: Miki IceWorld

# ---- group: 01 INPUTS — metres / test assumptions
length = Slider(8, range=2..30)
lanewidth = Slider(1.5, range=0.8..3)
lanes = Slider(4, range=1..20)
turngap = Slider(1.8, range=0.8..4)
railheight = Slider(1.1, range=0.5..2)
railradius = Slider(0.025, range=0.01..0.1)
postspacing = Slider(1, range=0.25..3)

# ---- group: 02 GENERATION — preview geometry
queue_barriers = QueueBarriers(
    Length=length,
    LaneWidth=lanewidth,
    Lanes=lanes,
    TurnGap=turngap,
    RailHeight=railheight,
    RailRadius=railradius,
    PostSpacing=postspacing)  # -> Geometry, Roles, Source, Report

# ---- group: 03 OUTPUT / APPROVAL — button to bake
bake = ApprovedBake(Source=queue_barriers.Source, Bake=Button())
panel = Panel(queue_barriers.Report)
