# Grasshopper definition spiral-ornament.ghx (Grasshopper 1.0.9)
# plug-ins: Miki IceWorld

# ---- group: 01 INPUTS — metres / test assumptions
radius = Slider(2, range=0.5..10)
height = Slider(3, range=0.5..10)
turns = Slider(3, range=1..12)
tuberadius = Slider(0.04, range=0.01..0.15)

# ---- group: 02 GENERATION — preview geometry
spiral_ornament = SpiralOrnament(Radius=radius, Height=height, Turns=turns, TubeRadius=tuberadius)  # -> Geometry, Roles, Source, Report

# ---- group: 03 OUTPUT / APPROVAL — button to bake
bake = ApprovedBake(Source=spiral_ornament.Source, Bake=Button())
panel = Panel(spiral_ornament.Report)
