# Grasshopper definition straight-stair.ghx (Grasshopper 1.0.9)
# plug-ins: Miki IceWorld

# ---- group: 01 INPUTS — metres / test assumptions
rise = Slider(1.8, range=0.3..8)
run = Slider(3.6, range=1..15)
width = Slider(1.5, range=0.6..5)
risers = Slider(12, range=2..64)
railheight = Slider(1.1, range=0.5..2)
railradius = Slider(0.025, range=0.01..0.1)
postspacing = Slider(1, range=0.25..3)

# ---- group: 02 GENERATION — preview geometry
straight_stair = StraightStair(Rise=rise, Run=run, Width=width, Risers=risers, RailHeight=railheight, RailRadius=railradius, PostSpacing=postspacing)  # -> Geometry, Roles, Source, Report

# ---- group: 03 OUTPUT / APPROVAL — button to bake
bake = ApprovedBake(Source=straight_stair.Source, Bake=Button())
panel = Panel(straight_stair.Report)
